# Grasshopper definition Bridge tool v4.gh (Grasshopper 1.0.8)
# plug-ins: Human UI, Pufferfish, Human, Heron, ShapeDiverForGrasshopper

sddp = ShapeDiverDocumentPayload({AbsoluteTolerance=0, AngleTolerance=0, DistanceDisplayPrecision=0, GltfVersion="Gltf2", GrasshopperVersion="1.0.0008", InputGroups="{}", OutputGroups="{}", RelativeTolerance=0, RhinoVersion="8.16.25042.13001", UnitSystem=0, VersionCreated="1.22.0.0", VersionSaved="1.22.0.0"})

# ---- group: Read OSM data from Open Street Map export
path = FilePath("C:\Users\ATFD\OneDrive - Ramboll\Desktop\AEC Hackathon\map.osm")

# ----
importosm = ImportOSM(OSMDataLocation=path, Clipped=False)  # -> Extents, Fields, Values, FeatureGeometry, Buildings
# Pedestrian bridge location:
line = Line(Line((1404.474423, 789.0862006, 0), (1430.302828, 911.6628495, 0)))
data = Data(importosm.Buildings)
lng = ListLength(List=line)
tmatch = MatchText(Text=importosm.Fields, Pattern="highway", Case=True)
tstat = TreeStatistics(Tree=importosm.Fields)  # -> Paths, Length, Count
tmatch_2 = MatchText(Text=importosm.Fields, Pattern="railway", Case=True)
tstat_2 = TreeStatistics(Tree=importosm.Fields)  # -> Paths, Length, Count
ma = MassAddition(Input=tmatch)  # -> flatten(Result), PartialResults
equals = Equality(FirstNumber=lng, SecondNumber="1")  # -> Equality, Inequality
ma_2 = MassAddition(Input=tmatch_2)  # -> flatten(Result), PartialResults
dispatch = Dispatch(List=tstat.Paths, DispatchPattern=ma.Result)  # -> ListA, ListB
number_slider = Slider(0.9, range=0..1)
dispatch_2 = Dispatch(List=tstat_2.Paths, DispatchPattern=ma_2.Result)  # -> ListA, ListB
# Figure out coordinate system
branch = TreeBranch(Tree=importosm.FeatureGeometry, Path=dispatch.ListA, MaintainPaths=True)
branch_2 = TreeBranch(Tree=importosm.Values, Path=dispatch.ListA, MaintainPaths=True)
density = Data(["4.5091400146484375", "4.5091400146484375", "4.5091400146484375", "4.5091400146484375", "4.5091400146484375", "4.5091400146484375"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])
# Figure out coordinate system
branch_3 = TreeBranch(Tree=importosm.FeatureGeometry, Path=dispatch_2.ListA, MaintainPaths=True)
branch_4 = TreeBranch(Tree=importosm.Values, Path=dispatch_2.ListA, MaintainPaths=True)
jitter = Jitter(List=density, Jitter=number_slider, Seed=number_slider)  # -> Values, Indices
lng_2 = ListLength(List=density)
dom = ConstructDomain(DomainStart=Slider(0.9, range=0..1), DomainEnd=Slider(1.9, range=0..10))
highway = Data(branch)
tmatch_3 = MatchText(Text=branch_2, Pattern="motorway_junction", Case=True)
tmatch_4 = MatchText(Text=branch_2, Pattern="motorway_link", Case=True)
tmatch_5 = MatchText(Text=branch_2, Pattern="motorway", Case=True)
tmatch_6 = MatchText(Text=branch_2, Pattern="footway", Case=True)
tmatch_7 = MatchText(Text=branch_2, Pattern="path", Case=True)
tmatch_8 = MatchText(Text=branch_2, Pattern="pedestrian", Case=True)
railway = Data(branch_3)
random = Random(Range=dom, Number=lng_2, Seed=2)
tstat_3 = TreeStatistics(Tree=tmatch_3)  # -> Paths, Length, Count
tstat_4 = TreeStatistics(Tree=tmatch_4)  # -> Paths, Length, Count
tstat_5 = TreeStatistics(Tree=tmatch_5)  # -> Paths, Length, Count
tmatch_9 = MatchText(Text=branch_4, Pattern="subway", Case=True)
ma_3 = MassAddition(Input=tmatch_3)  # -> flatten(Result), PartialResults
ma_4 = MassAddition(Input=tmatch_4)  # -> flatten(Result), PartialResults
ma_5 = MassAddition(Input=tmatch_5)  # -> flatten(Result), PartialResults
ma_6 = MassAddition(Input=tmatch_6)  # -> flatten(Result), PartialResults
ma_7 = MassAddition(Input=tmatch_8)  # -> flatten(Result), PartialResults
ma_8 = MassAddition(Input=tmatch_7)  # -> flatten(Result), PartialResults
tstat_6 = TreeStatistics(Tree=tmatch_9)  # -> Paths, Length, Count
dispatch_3 = Dispatch(List=tstat_3.Paths, DispatchPattern=ma_3.Result)  # -> ListA, ListB
dispatch_4 = Dispatch(List=tstat_4.Paths, DispatchPattern=ma_4.Result)  # -> ListA, ListB
dispatch_5 = Dispatch(List=tstat_5.Paths, DispatchPattern=ma_5.Result)  # -> ListA, ListB
dispatch_6 = Dispatch(List=tstat_4.Paths, DispatchPattern=ma_6.Result)  # -> ListA, ListB
dispatch_7 = Dispatch(List=tstat_4.Paths, DispatchPattern=ma_8.Result)  # -> ListA, ListB
ma_9 = MassAddition(Input=tmatch_9)  # -> flatten(Result), PartialResults
dispatch_8 = Dispatch(List=tstat_4.Paths, DispatchPattern=ma_7.Result)  # -> ListA, ListB
data_2 = Data([Point(31134981.07, 859777325.3, 0), Point(31176370.82, 859777325.3, 0), Point(31197065.69, 859777325.3, 0), Point(31238455.44, 859777325.3, 0), Point(31259150.31, 859777325.3, 0), Point(31300540.06, 859777325.3, 0)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])
dispatch_9 = Dispatch(List=tstat_6.Paths, DispatchPattern=ma_9.Result)  # -> ListA, ListB
branch_5 = TreeBranch(Tree=highway, Path=dispatch_3.ListA, MaintainPaths=True)
branch_6 = TreeBranch(Tree=highway, Path=dispatch_4.ListA, MaintainPaths=True)
branch_7 = TreeBranch(Tree=highway, Path=dispatch_5.ListA, MaintainPaths=True)
branch_8 = TreeBranch(Tree=highway, Path=dispatch_6.ListA, MaintainPaths=True)
branch_9 = TreeBranch(Tree=highway, Path=dispatch_8.ListA, MaintainPaths=True)
branch_10 = TreeBranch(Tree=highway, Path=dispatch_7.ListA, MaintainPaths=True)
branch_11 = TreeBranch(Tree=railway, Path=dispatch_9.ListB, MaintainPaths=True)
merge = Merge(Data1=branch_8, Data2=branch_10, Data3=branch_9)
merge_2 = Merge(Data1=branch_7, Data2=branch_5, Data3=branch_6)
pedestrian = Data(merge)
number_slider_2 = Slider(4e-06, range=0..1e-05)
data_3 = Data(importosm.Extents)
highway_2 = Data(merge_2)
# Uncrossable lines
rail = Data(branch_11)
number_slider_3 = Slider(1e-06, range=0..1e-06)
debrep = DeconstructBrep(Brep=data_3)  # -> Faces, Edges, Vertices
item = ListItem(List=debrep.Vertices, Index=0, Wrap=True)
move = Move(Motion=Vector(0, 0, 10))  # -> Geometry, Transform
pdecon = Deconstruct(Point=item)  # -> XComponent, YComponent, ZComponent
pt = Point([<point referenced from the Rhino model> x3192])
X = UnitX(Factor=pdecon.XComponent)
move_2 = Move(Geometry=data_2, Motion=expr("-x", X))  # -> Geometry, Transform
Y = UnitY(Factor=pdecon.YComponent)
move_3 = Move(Geometry=move_2.Geometry, Motion=expr("-x", Y))  # -> Geometry, Transform
scale = Scale(Geometry=move_3.Geometry, Center=Point(0, 0, 0), Factor=Slider(1, range=0..1))  # -> Geometry, Transform
scale_2 = Scale(Geometry=move_3.Geometry, Center=Point(0, 0, 0), Factor=Slider(0.001, range=0..0.001))  # -> Geometry, Transform
sort_pt = SortPoints(Points=scale_2.Geometry)  # -> Points, Indices
merge_3 = Merge(Data1=rail, Data2=highway_2)
item_2 = ListItem(List=density, Index=sort_pt.Indices, Wrap=True)
multiplication = Multiplication(A=item_2, B=random)
sort = SortList(Keys=multiplication)  # -> Keys, ValuesA
item_3 = ListItem(List=sort.Keys, Index=0, Wrap=True)  # -> Item1, Item
gradient = Gradient(
    LowerLimit=item_3.Item,
    UpperLimit=item_3.Item1,
    Parameter=multiplication,
    stops=[0: RGB(0, 128, 0), 0.5: RGB(255, 255, 0), 1: RGB(255, 0, 0)])
sort_pt_2 = SortPoints(Points=pt)  # -> Points, Indices
item_4 = ListItem(List=sort_pt_2.Points, Index=Slider(54, range=0..100), Wrap=True)
cps = ClosestPoints(Point=item_4, Cloud=sort_pt_2.Points, Count=3)  # -> ClosestPoint, CPIndex, Distance
item_5 = ListItem(List=cps.ClosestPoint, Index=0, Wrap=True)  # -> Item, Item1
data_4 = Data(item_5.Item1)
dist = Distance(PointA=item_4, PointB=data_4)
dom_2 = ConstructDomain(DomainStart=expr("x/2", dist), DomainEnd=expr("-x/2", dist))
rectangle = Rectangle(Plane=sort_pt_2.Points, XSize=dom_2, YSize=dom_2, Radius=0)  # -> Rectangle, Length
boundary = BoundarySurfaces(Edges=rectangle.Rectangle)
number_slider_4 = Slider(1, range=0..1)
move_4 = Move(Geometry=data, Motion=expr("-x", X))  # -> Geometry, Transform
move_5 = Move(Geometry=pedestrian, Motion=expr("-x", X))  # -> Geometry, Transform
move_6 = Move(Geometry=merge_3, Motion=expr("-x", X))  # -> Geometry, Transform
move_7 = Move(Geometry=move_4.Geometry, Motion=expr("-x", Y))  # -> Geometry, Transform
move_8 = Move(Geometry=move_5.Geometry, Motion=expr("-x", Y))  # -> Geometry, Transform
move_9 = Move(Geometry=move_6.Geometry, Motion=expr("-x", Y))  # -> Geometry, Transform
swatch = ColourSwatch(SwatchColor=RGB(255, 170, 0))
swatch_2 = ColourSwatch(SwatchColor=RGB(0, 119, 255))
scale_3 = Scale(Geometry=move_7.Geometry, Center=Point(0, 0, 0), Factor=number_slider_4)  # -> Geometry, Transform
scale_4 = Scale(Geometry=move_8.Geometry, Center=Point(0, 0, 0), Factor=number_slider_4)  # -> Geometry, Transform
scale_5 = Scale(Geometry=move_9.Geometry, Center=Point(0, 0, 0), Factor=number_slider_4)  # -> Geometry, Transform
preview = CustomPreview(Geometry=scale_4.Geometry, Material=swatch_2)
preview_2 = CustomPreview(Geometry=scale_5.Geometry, Material=swatch)
preview_3 = CustomPreview(Geometry=scale_3.Geometry, Material=ColourSwatch(SwatchColor=RGB(168, 168, 168)))
line_2 = Line(Line((550, 1017, 0), (2251, 936, 0)))
python_3_script = Python3Script(xyPoint=sort_pt_2.Points, population_density=density, bridge_line=line, barrier_line=line_2)  # -> out, bridge_flow; inputs xyPoint: list of Point3d, population_density: list of Double, bridge_line: Line, barrier_line: Line
# ---------- python_3_script: Python ----------
# requirements: pandas, numpy, scipy, pyproj

# --- Imports ---
import numpy as np
import pandas as pd
from scipy.spatial.distance import cdist

# --- Functions ---
def load_data(csv_path):
    """Load and preprocess the data."""
    data = pd.read_csv(csv_path)
    data.rename(columns={'dnk_general_2020': 'population_density'}, inplace=True)
    return data

def calculate_population(data, grid_height, grid_width):
    """Calculate the population per grid cell."""
    data['population'] = data['population_density'] * (grid_height * grid_width)
    return data

def is_zone_affected(zone_x, zone_y, start, end, threshold=50):
    """Check if a zone is affected by the barrier (simple distance threshold)."""
    d = np.abs((end[1] - start[1]) * zone_x - (end[0] - start[0]) * zone_y + end[0] * start[1] - end[1] * start[0]) \
        / np.sqrt((end[1] - start[1]) ** 2 + (end[0] - start[0]) ** 2)
    return d < threshold

def is_zone_near_bridge(zone_x, zone_y, start, end, threshold=50):
    """Check if a zone is near the bridge (for travel allowance)."""
    d = np.abs((end[1] - start[1]) * zone_x - (end[0] - start[0]) * zone_y + end[0] * start[1] - end[1] * start[0]) \
        / np.sqrt((end[1] - start[1]) ** 2 + (end[0] - start[0]) ** 2)
    return d < threshold

def compute_distance_matrix(origins, destinations):
    """Compute the distance matrix between origin and destination zones."""
    origin_coords = origins[['x', 'y']].values
    dest_coords = destinations[['x', 'y']].values
    return cdist(origin_coords, dest_coords)

def gravity_model(population, distance, beta=2):
    """Compute the gravity model for trip distribution."""
    trip_matrix = population[:, None] / (distance ** beta)
    trip_matrix[np.isinf(trip_matrix)] = 0  # Handle division by zero
    return trip_matrix

# --- Get data from the input ---
x_coor = [pt.X for pt in xyPoint]
y_coor = [pt.Y for pt in xyPoint]
data = pd.DataFrame({'x':x_coor, 'y':y_coor, 'population_density':population_density})

# --- Recalculate Grid ---
latitude_ref = 55.6761  # Copenhagen latitude reference
grid_height = 30.87  # North-South spacing (constant)
grid_width = 30.87 * np.cos(np.radians(latitude_ref))  # East-West spacing

# --- Calculate population and add to the dataframe
data = calculate_population(data, grid_height, grid_width)
# print(data.head())

# --- Define Barriers ---
barrier_start = (barrier_line.FromX, barrier_line.FromY)  # Example (x, y)
barrier_end = (barrier_line.ToX, barrier_line.ToY)
data['affected_by_barrier'] = data.apply(lambda row: is_zone_affected(row['x'], row['y'], barrier_start, barrier_end), axis=1)
print(f'Barrier start/end coordinates: {barrier_start}, {barrier_end}')

# --- Define Bridge ---
bridge_start = (bridge_line.FromX, bridge_line.FromY)  # Example (x, y)
bridge_end = (bridge_line.ToX, bridge_line.ToY)
data['near_bridge'] = data.apply(lambda row: is_zone_near_bridge(row['x'], row['y'], bridge_start, bridge_end), axis=1)
print(f'Bridge start/end coordinates: {bridge_start}, {bridge_end}')

# --- Gravity Model ---
distance_matrix = compute_distance_matrix(data, data)
trip_matrix = gravity_model(data['population'].values, distance_matrix)

# --- Calculate Estimated Flow Across the Bridge ---
bridge_flow = round(np.sum(trip_matrix[data['near_bridge']]), 0)
print(f"Estimated flow across the bridge: {bridge_flow:.2f} people")
# ---------- end python_3_script ----------
panel = Panel("""LCA Data:
Steel - 1.1 kgCO2e/kg
Concrete - 4988 kgCO2e/kg
Timber - 133 kgCO2e/kg""")
concat = Concatenate(FragmentA="Legend:")
panel_2 = Panel(python_3_script.bridge_flow)
pt_2 = ConstructPoint(XCoordinate=Slider(30, range=0..100), YCoordinate=Slider(180, range=0..1000), ZCoordinate=0)
pt_3 = ConstructPoint(XCoordinate=Slider(30, range=0..100), YCoordinate=Slider(90, range=0..100), ZCoordinate=0)
pt_4 = ConstructPoint(XCoordinate=Slider(30, range=0..100), YCoordinate=Slider(120, range=0..1000), ZCoordinate=0)
pt_5 = ConstructPoint(XCoordinate=Slider(30, range=0..100), YCoordinate=Slider(150, range=0..1000), ZCoordinate=0)
pt_6 = ConstructPoint(XCoordinate=Slider(30, range=0..100), YCoordinate=Slider(210, range=0..1000), ZCoordinate=0)
texttoscreen = RenderTextToScreen(Text=concat, Location=pt_3, Size=Slider(17, range=0..100), Color=RGB(0, 0, 0), m_scWithvp=False)
texttoscreen_2 = RenderTextToScreen(Text="Existing pedestrian pathways - OSM", Location=pt_4, Size=12, Color=swatch_2, m_scWithvp=False)
texttoscreen_3 = RenderTextToScreen(Text="Non traversable rails and highways - OSM", Location=pt_5, Size=12, Color=swatch, m_scWithvp=False)
texttoscreen_4 = RenderTextToScreen(Text=panel, Location=pt_6, Size=12, Color=ColourSwatch(SwatchColor=RGB(0, 0, 0)), m_scWithvp=False)
concat_2 = Concatenate(FragmentA=python_3_script.bridge_flow, FragmentB=" person per day")
panel_3 = Panel("""1.1
4988
133""")
label = CreateLabel(LabelText="Number of pedestrian crossing the bridge: ", LabelSize=Slider(18, range=0..100), Justification=0)
label_2 = CreateLabel(LabelText="0 person per day", LabelSize=Slider(39, range=0..100), Justification=0)
panel_4 = Panel("1")
label_3 = CreateLabel(LabelText="Results:", LabelSize=Slider(23, range=0..100), Justification=0)
item_6 = ListItem(List=panel_3, Index=0, Wrap=True)  # -> Item, Item1, Item2
setlabel = SetLabelContents(LabelToModify=label_2, NewLabelContents=concat_2)
toggle = CreateToggle(Default=False, OnLabel="Population density - HDX - ON", OffLabel="Population density - HDX - OFF")
values = ValueListener(Elements=toggle, SomeProperty=True)  # -> Values, Indices
filter = StreamFilter(Gate=values.Values, Stream1=boundary)
preview_4 = CustomPreview(Geometry=filter, Material=gradient)
panel_5 = Panel("""Steel
Concrete
Timber""")
panel_6 = Panel("""0
0
0""")
chart = CreateChart(Data=panel_6, Names=panel_5, Title="Life Cycle Assessment (kgCO2e)", ChartType=Slider(2, range=0..10))
merge_4 = Merge(Data1=toggle, Data2=label_3, Data3=label, Data4=label_2, Data5=chart)

# ----
# Create Display Window
# + Open Human UI Window
panel_7 = Panel("AEC Hackathon Copenhagen 2025")
getscreen = GetScreenDimensions()  # -> Width, Height
multiplication_2 = Multiplication(A=getscreen.Height, B=Slider(0.43, range=0..1))
division = Division(A=getscreen.Width, B="2")
launchwin = LaunchWindow(Show=Toggle(True), Name=panel_7, Width=division, Height=multiplication_2, ChildStatus=1, EnableHorizScroll=False)
addelems = AddElements(Window=launchwin, Elements=flatten(merge_4), DoVLChecking=True)  # -> AddedElements, ElementNames

merge_5 = Merge(
    Data1=ColourSwatch(SwatchColor=RGB(255, 33, 33)),
    Data2=ColourSwatch(SwatchColor=RGB(150, 150, 150)),
    Data3=ColourSwatch(SwatchColor=RGB(255, 187, 0)))
chartappearance = ChartAppearance(ChartToModify=chart, Colors=merge_5)
end = EndPoints(Curve=line)  # -> Start, End
vec = Vector(line)
len = Length(Curve=line)
line_3 = Line(line)
Y_2 = UnitY(Factor=1)
vec_2 = Vector(line_3)
angle = Angle(VectorA=Y_2, VectorB=vec_2)  # -> Angle, Reflex
vec_3 = Vector(unitize(vec_2))
rad = Radians(Degrees=Slider(90, range=0..100))
addition = Addition(A=angle.Angle, B=rad)
xy = XYPlane(Origin=Point(0, 0, 0))
align = AlignPlane(Plane=xy, Direction=vec_2)  # -> Plane, Angle
swatch_3 = ColourSwatch(SwatchColor=RGB(0, 168, 45))
texttoscreen_5 = RenderTextToScreen(Text="Proposed new pedestrian bridge", Location=pt_2, Size=12, Color=swatch_3, m_scWithvp=False)

# ----
# FOOTBRIDGE
# BACKGROUND
# PARAMETERS
# User options
# Fixed parameters
image = ImageSampler(Filter="Colour", Interpolate=False, Umax=1, Umin=0, Vmax=1, Vmin=0, Wrap=1)
image_2 = ImageSampler(Filter="Colour", Interpolate=False, Umax=1, Umin=0, Vmax=1, Vmin=0, Wrap=1)
image_3 = ImageSampler(Filter="Colour", Interpolate=False, Umax=1, Umin=0, Vmax=1, Vmin=0, Wrap=1)
image_4 = ImageSampler(Filter="Colour", Interpolate=False, Umax=1, Umin=0, Vmax=1, Vmin=0, Wrap=1)
image_5 = ImageSampler(Filter="Colour", Interpolate=False, Umax=1, Umin=0, Vmax=1, Vmin=0, Wrap=1)
image_6 = ImageSampler(Filter="Colour", Interpolate=False, Umax=1, Umin=0, Vmax=1, Vmin=0, Wrap=1)
image_7 = ImageSampler(Filter="Colour", Interpolate=False, Umax=1, Umin=0, Vmax=1, Vmin=0, Wrap=1)
image_8 = ImageSampler(Filter="Colour", Interpolate=False, Umax=1, Umin=0, Vmax=1, Vmin=0, Wrap=1)
add_roof = BooleanToggle(True)
add_lift = BooleanToggle(True)
span_4_to_20_m = Slider(19.8, range=4..20)
clearance_height_6_8_m = Slider(6.85, range=6..8)
stair_width_m = Panel("2")
num = Number(stair_width_m)
bool = Boolean(invert(add_roof))
bool_2 = Boolean(invert(add_lift))
num_2 = Number(span_4_to_20_m)
num_3 = Number(clearance_height_6_8_m)
num_4 = Number(num)

elevator_roof_thickness_m = Panel("0.4")
crv = Curve(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)
deck_thickness_m = Panel("0.348")
added_height_elevator_m = Panel("3")
num_5 = Number(num_3)
crv_2 = Curve([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])
crv_3 = Curve([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])

num_6 = Number(num_3)
deck_thickness_m_2 = Panel("0.348")
deck_height_m = Panel("0.2")
ideal_riser_height_m = Panel("0.15")
tread_depth_m = Panel("0.3")
platform_length_m = Panel("1.5")
railing_thickness_m = Panel("0.04")
railing_height_m = Panel("0.979")

# ---- group: Create stairs & handrail based on clearance height
addition_2 = Addition(A=num_6, B=deck_thickness_m_2)
addition_3 = Addition(A=addition_2, B=deck_height_m)
addition_4 = Addition(A=ideal_riser_height_m, B=railing_height_m)
division_2 = Division(A=addition_3, B=ideal_riser_height_m)
Z = UnitZ(Factor=expr("-x", ideal_riser_height_m))
series = Series(Start=0, Step=ideal_riser_height_m, Count=division_2)
series_2 = Series(Start=0, Step=tread_depth_m, Count=expr("x-1", division_2))
lng_3 = ListLength(List=series_2)
pt_7 = ConstructPoint(XCoordinate=0, YCoordinate="-2.5", ZCoordinate=0)
Z_2 = UnitZ(Factor=series)
division_3 = Division(A=lng_3, B=2)
mod = Modulus(A=lng_3, B=2)
move_10 = Move(Geometry=pt_7, Motion=Z_2)  # -> Geometry, Transform
dup = DuplicateData(Data=0, Number=expr("x/2", lng_3), Order=True)
larger = LargerThan(FirstNumber=mod, SecondNumber=0)  # -> LargerThan, OrEqualTo
subtraction = Subtraction(A=division_3, B=1)
mod_2 = Modulus(A=lng_3, B=2)
subtraction_2 = Subtraction(A=lng_3, B=1)
filter_2 = StreamFilter(Gate=larger.LargerThan, Stream0=division_3, Stream1=subtraction)
addition_5 = Addition(A=filter_2, B=1)
subtraction_3 = Subtraction(A=addition_5, B=1)
larger_2 = LargerThan(FirstNumber=mod_2, SecondNumber=0)  # -> LargerThan, OrEqualTo
dup_2 = DuplicateData(Data=platform_length_m, Number=filter_2, Order=True)
subtraction_4 = Subtraction(A=filter_2, B=1)
merge_6 = Merge(Data1=dup, Data2=dup_2)
addition_6 = Addition(A=series_2, B=merge_6)
filter_3 = StreamFilter(Gate=larger_2.LargerThan, Stream0=subtraction_4, Stream1=filter_2)
filter_4 = StreamFilter(Gate=larger_2.LargerThan, Stream0=subtraction_3, Stream1=addition_5)
shift = ShiftList(List=move_10.Geometry, Shift=1, Wrap=False)  # -> reverse(List)
Y_3 = UnitY(Factor=expr("-x", addition_6))
move_11 = Move(Geometry=shift, Motion=Y_3)  # -> Geometry, Transform
merge_7 = Merge(Data1=flatten("0"), Data2=flatten(filter_3), Data3=flatten(filter_4), Data4=flatten(subtraction_2))
move_12 = Move(Geometry=move_11.Geometry, Motion=Z)  # -> Geometry, Transform
shift_2 = ShiftList(List=move_11.Geometry, Shift=1, Wrap=False)
item_7 = ListItem(List=move_12.Geometry, Index=merge_7, Wrap=True)
item_8 = ListItem(List=reverse(item_7), Index=0, Wrap=True)
ln = Line(StartPoint=move_11.Geometry, EndPoint=move_12.Geometry)
shift_3 = ShiftList(List=move_12.Geometry, Shift=-1, Wrap=False)
Y_4 = UnitY(Factor=-0.5)
Z_3 = UnitZ(Factor=addition_4)
ln_2 = Line(StartPoint=shift_2, EndPoint=shift_3)
lng_4 = ListLength(List=item_7)
move_13 = Move(Geometry=item_8, Motion=Y_4)  # -> Geometry, Transform
join = JoinCurves(Curves=[ln_2, ln], Preserve=False)
X_2 = UnitX(Factor=num_4)
ins = InsertItems(List=item_7, Item=move_13.Geometry, Indices=lng_4, Wrap=True)
extr = Extrude(Base=join, Direction=X_2)
pline = PolyLine(Vertices=ins, Closed=False)
extr_2 = Extrude(Base=pline, Direction=Z_3)
X_3 = UnitX(Factor=expr("-x", railing_thickness_m))
join_2 = BrepJoin(Breps=flatten(extr))  # -> Breps, Closed
extr_3 = Extrude(Base=extr_2, Direction=X_3)
cap = CapHoles(Brep=extr_3)
addition_7 = Addition(A=num_4, B=railing_thickness_m)
X_4 = UnitX(Factor=addition_7)
move_14 = Move(Geometry=cap, Motion=X_4)  # -> Geometry, Transform
geo = Geometry(join_2.Breps)
geo_2 = Geometry([move_14.Geometry, cap])

# ----
X_5 = UnitX(Factor=expr("-x", railing_thickness_m))
Z_4 = UnitZ(Factor=railing_height_m)
X_6 = UnitX(Factor=addition_7)

# ---- group: Lift shaft
addition_8 = Addition(A=num_5, B=deck_thickness_m)
addition_9 = Addition(A=addition_8, B=added_height_elevator_m)
Z_5 = UnitZ(Factor=addition_9)
Z_6 = UnitZ(Factor=elevator_roof_thickness_m)
extr_4 = Extrude(Base=crv, Direction=Z_6)
extr_5 = Extrude(Base=crv_2, Direction=Z_5)
extr_6 = Extrude(Base=crv_3, Direction=Z_5)
cap_2 = CapHoles(Brep=extr_4)
subtraction_5 = Subtraction(A=Z_5, B=Z_6)
cap_3 = CapHoles(Brep=extr_6)
cap_4 = CapHoles(Brep=extr_5)
move_15 = Move(Geometry=cap_2, Motion=subtraction_5)  # -> Geometry, Transform

# ----
merge_8 = Merge(Data1=move_15.Geometry, Data2=cap_4, Data3=cap_3)
group = Group(Objects=merge_8)

# ---- group: Technology room
pt_8 = Point(item_8)
curvepoint = PointOnCurve(pline, parameter=0.797)
pdecon_2 = Deconstruct(Point=curvepoint)  # -> XComponent, YComponent, ZComponent
pt_9 = ConstructPoint(XCoordinate=pdecon_2.XComponent, YCoordinate=pdecon_2.YComponent, ZCoordinate=0)
merge_9 = Merge(Data1=flatten(pt_8), Data2=flatten(curvepoint), Data3=flatten(pt_9))
pline_2 = PolyLine(Vertices=merge_9, Closed=True)
vec_4 = Vector(X_2)
extr_7 = Extrude(Base=pline_2, Direction=vec_4)
cap_5 = CapHoles(Brep=extr_7)
geo_3 = Geometry(cap_5)

# ---- group: Geometry output - Stais, Handrail, Technology room
merge_10 = Merge(Data1=flatten(geo), Data2=flatten(geo_2), Data3=flatten(geo_3))
division_4 = Division(A=num_4, B=-2)
X_7 = UnitX(Factor=division_4)
move_16 = Move(Geometry=merge_10, Motion=X_7)  # -> Geometry, Transform

# ----
division_5 = Division(A=len, B=num_2)
multiplication_3 = Multiplication(A=vec_3, B=num_2)
multiplication_4 = Multiplication(A=division_5, B="100")

crv_4 = Curve([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])
crv_5 = Curve(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)
crv_6 = Curve(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)
crv_7 = Curve([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])
crv_8 = Curve([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])
num_7 = Number(num_2)

# ---- group: Platform
Z_7 = UnitZ(Factor=expr("-x", "0.348"))
extr_8 = Extrude(Base=crv_5, Direction=Z_7)
cap_6 = CapHoles(Brep=extr_8)

# ---- group: Bridge deck
merge_11 = Merge(Data1=crv_6, Data2=crv_7, Data3=crv_8)
X_8 = UnitX(Factor=num_7)
extr_9 = Extrude(Base=merge_11, Direction=X_8)
cap_7 = CapHoles(Brep=extr_9)
X_9 = UnitX(Factor=1)

# ---- group: Platform beams
explode = Explode(Curve=crv_5, Recursive=True)  # -> Segments, Vertices
len_2 = Length(Curve=explode.Segments)
sort_2 = SortList(Keys=len_2, ValuesA=explode.Segments)  # -> Keys, ValuesA
item_9 = ListItem(List=reverse(sort_2.ValuesA), Index=0, Wrap=True)
Z_8 = UnitZ(Factor=expr("-x", "0.5"))
ext = ExtendCurve(Curve=item_9, Type=0, Start=0, End=3)
X_10 = UnitX(Factor="0.05")
extr_10 = Extrude(Base=ext, Direction=Z_8)
extr_11 = Extrude(Base=extr_10, Direction=X_10)
X_11 = UnitX(Factor=expr("-x", "2"))
item_10 = ListItem(List=sort_2.ValuesA, Index=0, Wrap=True)
extr_12 = Extrude(Base=pline, Direction=X_11)
X_12 = UnitX(Factor=item_10)

# ---- group: Platform handrail
extr_13 = Extrude(Base=crv_4, Direction=Z_4)

# ---- group: Deck centerline
pt_10 = ConstructPoint(XCoordinate=0, YCoordinate=0, ZCoordinate=0)
pt_11 = ConstructPoint(XCoordinate=num_7, YCoordinate=0, ZCoordinate=0)
ln_3 = Line(StartPoint=pt_10, EndPoint=pt_11)

# ----
pt_12 = Point(move_10.Geometry)
item_11 = ListItem(List=move_12.Geometry, Index=filter_3, Wrap=True)
pt_13 = Point(pt_9)

pt_14 = Point(pt_12)

# ---- group: Platform beams (continued)
pdecon_3 = Deconstruct(Point=pt_14)  # -> XComponent, YComponent, reverse(ZComponent)
item_12 = ListItem(List=pdecon_3.ZComponent, Index=0, Wrap=True)
subtraction_6 = Subtraction(A=item_12, B="0.348")
Z_9 = UnitZ(Factor=item_12)
Z_10 = UnitZ(Factor=subtraction_6)
move_17 = Move(Geometry=extr_11, Motion=Z_10)  # -> Geometry, Transform
split = SplitBrep(Brep=move_17.Geometry, Cutter=extr_12)
item_13 = ListItem(List=reverse(split), Index=0, Wrap=True)
cap_8 = CapHoles(Brep=item_13)
move_18 = Move(Geometry=cap_8, Motion=X_12)  # -> Geometry, Transform

# ---- group: Platform handrail (continued)
move_19 = Move(Geometry=extr_13, Motion=Z_9)  # -> Geometry, Transform
extr_14 = Extrude(Base=move_19.Geometry, Direction=X_5)
move_20 = Move(Geometry=extr_14, Motion=X_6)  # -> Geometry, Transform
cull_i = CullIndex(List=move_20.Geometry, Indices="1", Wrap=True)

# ---- group: Bridge deck (continued)
addition_10 = Addition(A=Z_9, B=X_9)
move_21 = Move(Geometry=cap_7, Motion=addition_10)  # -> Geometry, Transform

# ---- group: Deck centerline (continued)
move_22 = Move(Geometry=ln_3, Motion=addition_10)  # -> Geometry, Transform

# ----
crv_9 = Curve(pline)
pt_15 = Point(item_11)

crv_10 = Curve(move_22.Geometry)

crv_11 = Curve(crv_9)

pt_16 = Point(pt_13)
pt_17 = Point(pt_15)

# ---- group: Stair roof
Z_11 = UnitZ(Factor="3.05")
move_23 = Move(Geometry=crv_11, Motion=Z_11)  # -> Geometry, Transform
explode_2 = Explode(Curve=move_23.Geometry, Recursive=True)  # -> Segments, Vertices
lng_5 = ListLength(List=explode_2.Vertices)
cull_i_2 = CullIndex(List=explode_2.Vertices, Indices=expr("x-1", lng_5), Wrap=True)
item_14 = ListItem(List=cull_i_2, Index=0, Wrap=True)
Y_5 = UnitY(Factor="4.6")
move_24 = Move(Geometry=item_14, Motion=Y_5)  # -> Geometry, Transform
Z_12 = UnitZ(Factor="0.15")
X_13 = UnitX(Factor="1.25")
ins_2 = InsertItems(List=cull_i_2, Item=move_24.Geometry, Indices=lng_5, Wrap=True)
neg = Negative(Value=X_13)
panel_8 = Panel("""2
3""")
cull_i_3 = CullIndex(List=ins_2, Indices=panel_8, Wrap=True)
pline_3 = PolyLine(Vertices=cull_i_3, Closed=False)
addition_11 = Addition(A=X_13, B=Z_12)
addition_12 = Addition(A=neg, B=Z_12)
ext_2 = ExtendCurve(Curve=pline_3, Type=0, Start="0", End="0.6")
move_25 = Move(Geometry=ext_2, Motion=addition_12)  # -> Geometry, Transform
move_26 = Move(Geometry=ext_2, Motion=addition_11)  # -> Geometry, Transform
merge_12 = Merge(Data1=move_26.Geometry, Data2=ext_2)
merge_13 = Merge(Data1=ext_2, Data2=move_25.Geometry)
loft = Loft(Curves=merge_12, Options={Adjust=False, Closed=False, LoftEnds=0, LoftSimp=0, LoftType=0, Rebuild=10, Refit=0.01})
loft_2 = Loft(Curves=merge_13, Options={Adjust=False, Closed=False, LoftEnds=0, LoftSimp=0, LoftType=0, Rebuild=10, Refit=0.01})
join_3 = BrepJoin(Breps=[loft, loft_2])  # -> Breps, Closed
Z_13 = UnitZ(Factor=0.05)
extr_15 = Extrude(Base=join_3.Breps, Direction=Z_13)

# ---- group: Roof pillars
Z_14 = UnitZ(Factor=8)
move_27 = Move(Geometry=pt_16, Motion=Z_14)  # -> Geometry, Transform
rad_2 = Radians(Degrees="40")
neg_2 = Negative(Value=rad_2)
yz = YZPlane(Origin=pt_16)
division_6 = Division(A=neg_2, B="5")
rotate = Rotate(Geometry=move_27.Geometry, Angle=[rad_2, division_6], Plane=yz)  # -> Geometry, Transform
ln_4 = Line(StartPoint=pt_16, EndPoint=rotate.Geometry)
X_14 = UnitX(Factor="1.11")
move_28 = Move(Geometry=ln_4, Motion=X_14)  # -> Geometry, Transform
join_4 = JoinCurves(Curves=move_28.Geometry, Preserve=False)
dom_3 = ConstructDomain(DomainStart=expr("-x", "0.07"), DomainEnd="0.07")
end_2 = EndPoints(Curve=join_4)  # -> Start, End
pt_18 = Point(pt_16)
multiplication_5 = Multiplication(A=X_14, B=-2)
vec2pt = Vector2Pt(PointA=pt_18, PointB=pt_17, Unitize=False)  # -> Vector, Length
rectangle_2 = Rectangle(Plane=end_2.Start, XSize=dom_3, YSize=dom_3, Radius=0)  # -> Rectangle, Length
extrcrv = ExtrudeAlong(Base=rectangle_2.Rectangle, Curve=join_4)
move_29 = Move(Geometry=extrcrv, Motion=vec2pt.Vector)  # -> Geometry, Transform
split_2 = SplitBrep(Brep=extrcrv, Cutter=join_3.Breps)
split_3 = SplitBrep(Brep=move_29.Geometry, Cutter=join_3.Breps)
item_15 = ListItem(List=split_2, Index="2", Wrap=True)
item_16 = ListItem(List=split_3, Index="2", Wrap=True)
cap_9 = CapHoles(Brep=item_15)
cap_10 = CapHoles(Brep=item_16)
move_30 = Move(Geometry=[cap_9, cap_10], Motion=multiplication_5)  # -> Geometry, Transform

# ---- group: Bridge roof
Z_15 = UnitZ(Factor="3.05")
ext_3 = ExtendCurve(Curve=crv_10, Type=0, Start="-0.25", End="-0.25")
ext_4 = ExtendCurve(Curve=crv_10, Type=0, Start="-2", End="-2")
pt_19 = ConstructPoint(XCoordinate=0, YCoordinate=0, ZCoordinate=expr("8", 0))
pt_20 = ConstructPoint(XCoordinate=0, YCoordinate=0, ZCoordinate=0)
Y_6 = UnitY(Factor="1.4")
move_31 = Move(Geometry=ext_3, Motion=Z_15)  # -> Geometry, Transform
end_3 = EndPoints(Curve=ext_4)  # -> Start, End
ln_5 = Line(StartPoint=pt_20, EndPoint=pt_19)
neg_3 = Negative(Value="20")
move_32 = Move(Geometry=move_31.Geometry, Motion=expr("-x", Y_6))  # -> Geometry, Transform
move_33 = Move(Geometry=move_31.Geometry, Motion=Y_6)  # -> Geometry, Transform
rad_3 = Radians(Degrees=["20", neg_3])
xz = XZPlane(Origin=Point(0, 0, 0))
loft_3 = Loft(
    Curves=[move_33.Geometry, move_32.Geometry],
    Options={Adjust=False, Closed=False, LoftEnds=0, LoftSimp=0, LoftType=0, Rebuild=10, Refit=0.01})
Z_16 = UnitZ(Factor=0.05)
vec2pt_2 = Vector2Pt(PointA=pt_20, PointB=[end_3.Start, end_3.End], Unitize=False)  # -> Vector, Length
rotate_2 = Rotate(Geometry=ln_5, Angle=rad_3, Plane=xz)  # -> Geometry, Transform
join_5 = JoinCurves(Curves=rotate_2.Geometry, Preserve=False)
extr_16 = Extrude(Base=loft_3, Direction=Z_16)
domain = Domain(dom_3)
end_4 = EndPoints(Curve=join_5)  # -> Start, End
rectangle_3 = Rectangle(Plane=end_4.Start, XSize=domain, YSize=domain, Radius=0)  # -> Rectangle, Length
extrcrv_2 = ExtrudeAlong(Base=rectangle_3.Rectangle, Curve=join_5)
move_34 = Move(Geometry=extrcrv_2, Motion=vec2pt_2.Vector)  # -> Geometry, Transform
split_4 = SplitBrep(Brep=move_34.Geometry, Cutter=loft_3)
Y_7 = UnitY(Factor="1.309")
item_17 = ListItem(List=split_4, Index="2", Wrap=True)
num_8 = Number(num_2)
neg_4 = Negative(Value=Y_7)
move_35 = Move(Geometry=item_17, Motion=[Y_7, neg_4])  # -> Geometry, Transform
smaller = SmallerThan(FirstNumber=num_8, SecondNumber="8")  # -> SmallerThan, OrEqualTo

# ----
filter_5 = StreamFilter(Gate=smaller.SmallerThan, Stream0=move_35.Geometry)
cap_11 = CapHoles(Brep=extr_16)

move_36 = Move(Geometry=cap_6, Motion=Z_9)  # -> Geometry, Transform
group_2 = Group(Objects=move_21.Geometry)
crv_12 = Curve(move_22.Geometry)
geo_4 = Geometry([extr_14, cull_i])
geo_5 = Geometry([cap_8, move_18.Geometry])
cap_12 = CapHoles(Brep=extr_15)
geo_6 = Geometry([cap_11, filter_5])
geo_7 = Geometry([move_30.Geometry, cap_9, cap_10])

# ---- group: Mirror stairs & lift and visualisation grouping
geo_8 = Geometry(group_2)
geo_9 = Geometry(move_36.Geometry)
bbox = BoundingBox(Content=geo_8, Plane=PlaneXY(0, 0, 0))  # -> Box, Box_2
entwine = Entwine(
    Branch00=merge_8,
    Branch01=geo_5,
    Branch02=move_16.Geometry,
    Branch03=cap_12,
    Branch04=geo_7,
    Branch05=geo_4,
    Branch06=geo_9,
    FlattenInputs=True)
volume = Volume(Geometry=bbox.Box)  # -> Volume, Centroid
yz_2 = YZPlane(Origin=volume.Centroid)
mirror = Mirror(Geometry=entwine, Plane=yz_2)  # -> Geometry, Transform
geo_10 = Geometry(group_2)
ungroup = Ungroup(Group=geo_10)
bang = ExplodeTree(Data=mirror.Geometry)  # -> Branch0, Branch1, Branch2, Branch3, Branch4, Branch5, Branch6
bang_2 = ExplodeTree(Data=entwine)  # -> Branch0, Branch1, Branch2, Branch3, Branch4, Branch5, Branch6
item_18 = ListItem(List=ungroup, Index=0, Wrap=True)  # -> Item, Item1, Item2, Item3, Item4
geo_11 = Geometry(geo_6)
panel_9 = Panel("""0
1
2""")
panel_10 = Panel("""3
4""")
geo_12 = Geometry([bang_2.Branch0, bang.Branch0])
item_19 = ListItem(List=geo_12, Index=panel_9, Wrap=True)
item_20 = ListItem(List=geo_12, Index=panel_10, Wrap=True)  # -> flatten(Item)
geo_13 = Geometry([bang_2.Branch1, bang.Branch1, bang_2.Branch2, bang.Branch2, bang_2.Branch5, bang.Branch5, bang_2.Branch6, bang.Branch6, item_18.Item, item_18.Item1, item_18.Item2])
geo_14 = Geometry([bang_2.Branch3, bang.Branch3, bang_2.Branch4, bang.Branch4, geo_11])
geo_15 = Geometry([item_18.Item3, item_18.Item4])
bool_3 = Boolean(bool_2)
bool_4 = Boolean(bool)
gate = StreamGate(Stream=item_19, Gate=bool_3)  # -> Target0, Target1
gate_2 = StreamGate(Stream=geo_14, Gate=bool_4)  # -> Target0, Target1
swatch_4 = ColourSwatch(SwatchColor=RGB(189, 189, 189))
preview_5 = CustomPreview(Geometry=gate.Target0, Material=swatch_4)
preview_6 = CustomPreview(Geometry=item_20, Material=ColourSwatch(SwatchColor=RGB(110, 110, 110)))
preview_7 = CustomPreview(Geometry=geo_13, Material=swatch_4)
preview_8 = CustomPreview(
    Geometry=gate_2.Target0,
    Material={diffuse=RGB(221, 160, 221), emission=RGB(66, 48, 66), shine=0.5, specular=RGB(255, 255, 255), transparency=0})
preview_9 = CustomPreview(Geometry=geo_15, Material=ColourSwatch(SwatchColor=RGBA(130, 218, 255, 124)))

# ----
merge_14 = Merge(Data1=item_19, Data2=item_20, Data3=geo_13, Data4=geo_14, Data5=geo_15)
bbox_2 = BoundingBox(Content=flatten(entwine), Plane=PlaneXY(0, 0, 0), UnionBox=True)  # -> Box, Box_2
debrep_2 = DeconstructBrep(Brep=bbox_2.Box)  # -> Faces, Edges, Vertices
area = Area(Geometry=debrep_2.Faces)  # -> Area, Centroid
item_21 = ListItem(List=debrep_2.Vertices, Index=0, Wrap=True)
pdecon_4 = Deconstruct(Point=area.Centroid)  # -> XComponent, YComponent, ZComponent
item_22 = ListItem(List=debrep_2.Vertices, Index=0, Wrap=True)
sort_3 = SortList(Keys=pdecon_4.ZComponent, ValuesA=debrep_2.Faces)  # -> Keys, ValuesA
move2pt = MoveToPoint(Geometry=geo_8, PointA=item_21, PointB=end.Start)  # -> Moved, Vector, Transform
item_23 = ListItem(List=sort_3.ValuesA, Index=0, Wrap=True)  # -> Item1, Item
move2pt_2 = MoveToPoint(Geometry=entwine, PointA=item_22, PointB=end.Start)  # -> Moved, Vector, Transform
edges = BrepEdges(Brep=item_23.Item)  # -> Naked, Interior, NonManifold
len_3 = Length(Curve=edges.Naked)
sort_4 = SortList(Keys=len_3, ValuesA=edges.Naked)  # -> Keys, ValuesA
item_24 = ListItem(List=sort_4.ValuesA, Index=0, Wrap=True)  # -> Item1, Item
vec_5 = Vector(item_24.Item1)
data_5 = Data(item_24.Item1)
rotate_3 = Rotate(Geometry=move2pt.Moved, Angle=addition, Plane=end.Start)  # -> simplify(Geometry), Transform
bbox_3 = BoundingBox(Content=rotate_3.Geometry, Plane=align.Plane, UnionBox=True)  # -> Box, Box_2
rotate_4 = Rotate(Geometry=move2pt_2.Moved, Angle=addition, Plane=end.Start)  # -> simplify(Geometry), Transform
debrep_3 = DeconstructBrep(Brep=bbox_3.Box)  # -> Faces, Edges, Vertices
item_25 = ListItem(List=debrep_3.Vertices, Index=0, Wrap=True)
xy_2 = XYPlane(Origin=item_25)
align_2 = AlignPlane(Plane=xy_2, Direction=vec_2)  # -> Plane, Angle
move_37 = Move(Geometry=rotate_4.Geometry, Motion=vec)  # -> Geometry, Transform
scale_nu = ScaleNU(Geometry=rotate_3.Geometry, Plane=align_2.Plane, ScaleX=division_5, ScaleY=1, ScaleZ=1)  # -> Geometry, Transform
merge_15 = Merge(Data1=move_37.Geometry, Data2=rotate_4.Geometry, Data3=scale_nu.Geometry)  # -> flatten(Result)
bbox_4 = BoundingBox(Content=merge_15, Plane=align.Plane, UnionBox=True)  # -> Box, Box_2
preview_10 = CustomPreview(Geometry=merge_15, Material=swatch_3)
volume_2 = Volume(Geometry=bbox_4.Box)  # -> Volume, Centroid
ma_10 = MassAddition(Input=volume_2.Volume)  # -> Result, PartialResults
division_7 = Division(A=ma_10.Result, B=Slider(1000, range=0..1000))
multiplication_6 = Multiplication(A=division_7, B=Slider(50, range=0..100))
multiplication_7 = Multiplication(A=division_7, B=Slider(24, range=0..100))
multiplication_8 = Multiplication(A=division_7, B=Slider(37, range=0..100))
panel_11 = Panel(multiplication_8)
panel_12 = Panel(multiplication_6)
panel_13 = Panel(multiplication_7)
entwine_2 = Entwine(Branch00=multiplication_8, Branch01=multiplication_6, Branch02=multiplication_7, FlattenInputs=True)  # -> flatten(Result)
sort_5 = SortList(Keys=entwine_2)  # -> Keys, ValuesA
item_26 = ListItem(List=sort_5.Keys, Index=0, Wrap=True)  # -> Item1, Item
division_8 = Division(A=entwine_2, B=item_26.Item1)
multiplication_9 = Multiplication(A=division_8, B="100")
round = Round(Number=entwine_2)  # -> Nearest, Floor, Ceiling
filter_6 = StreamFilter(Gate=equals.Equality, Stream1=round.Nearest)
setchart = SetChartContents(ChartToModify=chart, NewChartValues=filter_6)
